# Dynamo graph script.dyn (Dynamo 2.12.1.8246)
# packages: MEPover 2022.10.30, Data-Shapes 2023.2.112, Genius Loci 2023.7.13

# group: Select Model Elements, Filter by Category
code_block = CodeBlock { "Click Finish when Lines are selected"; }
categories_list = Custom[Categories list]()  # package Data-Shapes; Gives list of all Revit categories and a matching list of their names
code_block_2 = CodeBlock { "Lines"; }
contains = String.Contains(string=categories_list.Category_name_s, searchFor=code_block_2)
filterByBoolMask = List.FilterByBoolMask(list=categories_list.Revit_Categories, mask=contains)
ui_selectmodelelements_data = Custom[UI.SelectModelElements Data](InputName=code_block, CategoryFilter=filterByBoolMask.in)  # package Data-Shapes; Creates a Revit element selection input for UI.MultipleInputForm++ . Check out www.data-shapes.net for more infos!

string = StringInput("Pipe Type")

# group: Choose "***Type"
select_type = ElementTypes("PipeType")  # graph input

# group: Gather Pipe Types
all_elements_of_type = ElementsOfType(element_type=select_type)
name = Element.Name(element=all_elements_of_type)
ui_dropdown_data = Custom[UI.DropDown Data](InputName=string, Keys=name, Values=all_elements_of_type)  # package Data-Shapes; Create data for DropDown input in UI.MultiInputForm ++ . Check out www.data-shapes.net for more infos.

string_2 = StringInput("Piping System")
select_type_2 = ElementTypes("PipingSystemType")  # graph input

# group: Gather Conduit Types
all_elements_of_type_2 = ElementsOfType(element_type=select_type_2)
name_2 = Element.Name(element=all_elements_of_type_2)
ui_dropdown_data_2 = Custom[UI.DropDown Data](InputName=string_2, Keys=name_2, Values=all_elements_of_type_2)

# group: Gather Levels
code_block_3 = CodeBlock { "Level"; }
collector_of_levels = Custom[Collector of Levels]()  # package Genius Loci; Collects the levels in the active or given document and sort them by elevation.
flatten = List.Flatten(list=collector_of_levels.Name)
flatten_2 = List.Flatten(list=collector_of_levels.Element)
ui_dropdown_data_3 = Custom[UI.DropDown Data](InputName=code_block_3, Keys=flatten, Values=flatten_2)

# group: Assign pipe size
code_block_4 = CodeBlock { "Size"; }
code_block_5 = CodeBlock { "50"; "110"; "160"; "200"; "250"; }
list_create = List.Create(item0=code_block_5.out0, item1=code_block_5.out1, item2=code_block_5.out2, item3=code_block_5.out3, item4=code_block_5.out4)
dropdown_data = Custom[DropDown Data](InputName=code_block_4, Keys=list_create, Values=list_create)  # package Data-Shapes; Create data for DropDown input in UI.MultiInputForm ++ . Check out www.data-shapes.net for more infos.

# group: Distance Offset
code_block_6 = CodeBlock { "Distance Offset"; }

code_block_7 = CodeBlock { ""; }
ui_textbox_data = Custom[UI.TextBox Data](InputName=code_block_6, DefaultText=code_block_7)  # package Data-Shapes; Create Data for TextBox input in UI.MultipleInputForm ++ . Check out www.data-shapes.net for more informations

# group: RESET
# note: (Set to False and Run to refresh the graph. Set to True when you're ready to Run again.)
RESET = BoolSelector(true)  # graph input

# group: Creates a User Interface
code_block_8 = CodeBlock { "Convert Model Lines to Revit Pipe"; }
code_block_9 = CodeBlock { "Run"; }
create = List.Create(item0=ui_selectmodelelements_data, item1=ui_dropdown_data, item2=ui_dropdown_data_2, item3=ui_dropdown_data_3, item4=dropdown_data, item5=ui_textbox_data)
code_block_10 = CodeBlock { "Cancel"; }
# note: Package:  Data-Shapes
ui_multipleinputform = Custom[UI.MultipleInputForm ++](Description_optional=code_block_8, ButtonText_optional=code_block_9, Inputs=create, Toggle=RESET, CancelButtonText_optional=code_block_10)  # package Data-Shapes; Create a form with multiple inputs. see www.data-shapes.net for tutorials and infos!

# group: Sort data, format lines and diameter
code_block_11 = CodeBlock(mdlines=ui_multipleinputform.User_Inputs, pipetype=ui_multipleinputform.User_Inputs, pipesys=ui_multipleinputform.User_Inputs, lvl=ui_multipleinputform.User_Inputs, diam=ui_multipleinputform.User_Inputs, offst=ui_multipleinputform.User_Inputs) { mdlines[0]; pipetype[1]; pipesys[2]; lvl[3]; diam[4]; offst[5]; }
geometry = Element.Geometry(element=code_block_11.out0)
flatten_3 = List.Flatten(list=geometry)
toNumber = String.ToNumber(string=code_block_11.out4)
floor = Math.Floor(number=toNumber)

ZAxis = Vector.ZAxis()
toNumber_2 = String.ToNumber(string=code_block_11.out5)
floor_2 = Math.Floor(number=toNumber_2)
translate = Geometry.Translate(geometry=flatten_3, direction=ZAxis, distance=floor_2)
# note: Package:  MEPover
byLines = Custom[Pipe.ByLines](Lines=translate, PipeType=code_block_11.out1, SystemType=code_block_11.out2, level=code_block_11.out3, Diameter=floor)  # package MEPover; Creates a pipe by Line, PipeType, SystemType, Level and Diameter
byMEPCurves = Custom[Elbow.ByMEPCurves](MEPCurves=byLines)  # package MEPover; Takes in a list of MEPCurves (pipe, duct, cable tray, conduit) and will attempt to create elbows where possible. A margin can be entered for max distance between connectors
